# Grasshopper definition Act_scene.gh (Grasshopper 1.0.8)
# plug-ins: Virtual Robot, Cassis, Vizor

md_slider = MDSlider(
    SliderMode=0,
    slider_value=Point(0.269776228, 0.7817036699, 0.5),
    x_domain=Domain(0, 1),
    y_domain=Domain(0, 1),
    z_domain=Domain(0, 1))
open_gripper = BooleanToggle(False)

deconstruct = Deconstruct(Point=expr("x*1000", md_slider))  # -> XComponent, YComponent, ZComponent
construct_point = ConstructPoint(XCoordinate=deconstruct.XComponent, YCoordinate=deconstruct.YComponent, ZCoordinate=Slider(150, range=0..1000))

cassis = Cassis(
    Prefix="http://localhost:3003/mcp/",
    EnabledTools="Remove_Script_Parameter,Modify_Script_Component_Parameters,Add_Script_Parameter,List_Python_Scripts,Get_Python_Script,Edit_Python_Script,Get_Python_Script_Errors,Edit_Script,Set_Component_Value,Get_Component_Output,GetAllConnections,ForceDocumentSolution,RecomputeScriptComponents,Get_Components_In_Group,Get_Parameter_TypeHints,GetDetailedComponentInfo")

# ---- group: physical_model
py3 = Python3Script(refresh=Button(), reset=Button())  # -> out, geometry; inputs refresh: Boolean
# ---------- py3: Python ----------
#! python 3

"""Load physical_model.json and emit Rhino Brep boxes for Grasshopper preview."""
import json
import os
import shutil

import Rhino.Geometry as rg
import System


def ensure_reset_input():
    component = ghenv.Component
    for param in component.Params.Input:
        if param.Name == "reset" or param.NickName == "reset":
            param.Name = "reset"
            param.NickName = "reset"
            param.Optional = True
            return False
    if component.Params.Input.Count == 0:
        raise RuntimeError("Cannot add reset input without a script input template")
    template = component.Params.Input[0]
    param = System.Activator.CreateInstance(template.GetType())
    param.Name = "reset"
    param.NickName = "reset"
    param.Optional = True
    param.Description = "Wire a Button here to reload physical_model.json from physical_model - Copy.json."
    component.Params.RegisterInputParam(param, component.Params.Input.Count)
    component.Params.OnParametersChanged()
    component.ExpireSolution(True)
    return True


def optional_input(name, fallback=None):
    value = globals().get(name, fallback)
    if value is None:
        return fallback
    text = str(value).strip()
    return text if text else fallback


def optional_bool(name, fallback=False):
    value = globals().get(name, fallback)
    if value is None:
        return fallback
    if isinstance(value, bool):
        return value
    text = str(value).strip().lower()
    if not text:
        return fallback
    return text in ("1", "true", "yes", "on")


def point3(values):
    return rg.Point3d(float(values[0]), float(values[1]), float(values[2]))


def unitized(vector, fallback):
    v = rg.Vector3d(vector)
    if v.Length <= 1e-9:
        v = rg.Vector3d(fallback)
    v.Unitize()
    return v


def stable_beam_plane(start, end):
    axis = end - start
    length = axis.Length
    if length <= 1e-9:
        raise ValueError("Beam axis has zero length")

    x_axis = unitized(axis, rg.Vector3d.XAxis)
    up = rg.Vector3d.ZAxis
    ref = rg.Vector3d.YAxis if abs(rg.Vector3d.Multiply(x_axis, up)) > 0.95 else up
    y_axis = rg.Vector3d.CrossProduct(ref, x_axis)
    y_axis = unitized(y_axis, rg.Vector3d.YAxis)

    center = rg.Point3d(
        (start.X + end.X) * 0.5,
        (start.Y + end.Y) * 0.5,
        (start.Z + end.Z) * 0.5,
    )
    return rg.Plane(center, x_axis, y_axis), length


def beam_to_brep(body, default_section):
    axis = body.get("axis") or {}
    start = point3(axis["start_xyz"])
    end = point3(axis["end_xyz"])
    plane, length = stable_beam_plane(start, end)

    dimensions = ((body.get("solid") or {}).get("dimensions") or {})
    section_y = float(dimensions.get("y", default_section.get("y", 0.04)))
    section_z = float(dimensions.get("z", default_section.get("z", 0.04)))

    box = rg.Box(
        plane,
        rg.Interval(-length * 0.5, length * 0.5),
        rg.Interval(-section_y * 0.5, section_y * 0.5),
        rg.Interval(-section_z * 0.5, section_z * 0.5),
    )
    brep = box.ToBrep()
    if brep:
        brep.UserDictionary.Set("common_model_id", body.get("id", ""))
        brep.UserDictionary.Set("common_model_family", body.get("family", ""))
        brep.UserDictionary.Set("common_model_label", body.get("label", ""))
    return brep


gh_path = ghenv.Component.OnPingDocument().FilePath.replace("/", "\\")
gh_dir = gh_path.rsplit("\\", 1)[0]
repo_root = gh_dir.rsplit("\\examples", 1)[0]
DEFAULT_MODEL_PATH = repo_root + r"\server\robot_control\shared_geometry\physical_model.json"
DEFAULT_RESET_MODEL_PATH = repo_root + r"\server\robot_control\shared_geometry\physical_model - Copy.json"

added_reset_input = ensure_reset_input()
model_file = optional_input("model_path", DEFAULT_MODEL_PATH)
reset_file = DEFAULT_RESET_MODEL_PATH
if optional_bool("reset"):
    if not os.path.exists(reset_file):
        raise FileNotFoundError("reset model copy not found: {0}".format(reset_file))
    with open(reset_file, "r", encoding="utf-8") as handle:
        json.load(handle)
    shutil.copyfile(reset_file, model_file)
    print("Reset {0} from {1}".format(model_file, reset_file))

if not os.path.exists(model_file):
    raise FileNotFoundError("common_model.json not found: {0}".format(model_file))

with open(model_file, "r", encoding="utf-8") as handle:
    model = json.load(handle)

default_section = (((model.get("defaults") or {}).get("solid") or {}).get("section") or {})
breps = []
labels = []
for body in model.get("bodies", []):
    brep = beam_to_brep(body, default_section)
    if brep:
        breps.append(brep)
        labels.append("{0} ({1}): {2}".format(body.get("id"), body.get("family"), body.get("label")))

geometry = breps
a = breps
if added_reset_input:
    print("Added reset input. Wire a Button to it, then press reset to reload the copy JSON.")
print("Loaded {0} beam Breps from {1}".format(len(breps), model_file))
print("Model: {0}".format(model.get("name", "unnamed")))
# ---------- end py3 ----------

# ----
hologram_model = Python3Script(refresh=Button(), reset=Button())  # -> out, geometry; inputs refresh: Boolean
# ---------- hologram_model: Python ----------
#! python 3

"""Load hologram_model.json and emit Rhino Brep boxes for Grasshopper preview."""
import json
import os
import shutil

import Rhino.Geometry as rg
import System


def ensure_reset_input():
    component = ghenv.Component
    for param in component.Params.Input:
        if param.Name == "reset" or param.NickName == "reset":
            param.Name = "reset"
            param.NickName = "reset"
            param.Optional = True
            return False
    if component.Params.Input.Count == 0:
        raise RuntimeError("Cannot add reset input without a script input template")
    template = component.Params.Input[0]
    param = System.Activator.CreateInstance(template.GetType())
    param.Name = "reset"
    param.NickName = "reset"
    param.Optional = True
    param.Description = "Wire a Button here to reload hologram_model.json from hologram_model - Copy.json."
    component.Params.RegisterInputParam(param, component.Params.Input.Count)
    component.Params.OnParametersChanged()
    component.ExpireSolution(True)
    return True


def optional_input(name, fallback=None):
    value = globals().get(name, fallback)
    if value is None:
        return fallback
    text = str(value).strip()
    return text if text else fallback


def optional_bool(name, fallback=False):
    value = globals().get(name, fallback)
    if value is None:
        return fallback
    if isinstance(value, bool):
        return value
    text = str(value).strip().lower()
    if not text:
        return fallback
    return text in ("1", "true", "yes", "on")


def point3(values):
    return rg.Point3d(float(values[0]), float(values[1]), float(values[2]))


def unitized(vector, fallback):
    v = rg.Vector3d(vector)
    if v.Length <= 1e-9:
        v = rg.Vector3d(fallback)
    v.Unitize()
    return v


def stable_beam_plane(start, end):
    axis = end - start
    length = axis.Length
    if length <= 1e-9:
        raise ValueError("Beam axis has zero length")

    x_axis = unitized(axis, rg.Vector3d.XAxis)
    up = rg.Vector3d.ZAxis
    ref = rg.Vector3d.YAxis if abs(rg.Vector3d.Multiply(x_axis, up)) > 0.95 else up
    y_axis = rg.Vector3d.CrossProduct(ref, x_axis)
    y_axis = unitized(y_axis, rg.Vector3d.YAxis)

    center = rg.Point3d(
        (start.X + end.X) * 0.5,
        (start.Y + end.Y) * 0.5,
        (start.Z + end.Z) * 0.5,
    )
    return rg.Plane(center, x_axis, y_axis), length


def beam_to_brep(body, default_section):
    axis = body.get("axis") or {}
    start = point3(axis["start_xyz"])
    end = point3(axis["end_xyz"])
    plane, length = stable_beam_plane(start, end)

    dimensions = ((body.get("solid") or {}).get("dimensions") or {})
    section_y = float(dimensions.get("y", default_section.get("y", 0.04)))
    section_z = float(dimensions.get("z", default_section.get("z", 0.04)))

    box = rg.Box(
        plane,
        rg.Interval(-length * 0.5, length * 0.5),
        rg.Interval(-section_y * 0.5, section_y * 0.5),
        rg.Interval(-section_z * 0.5, section_z * 0.5),
    )
    brep = box.ToBrep()
    if brep:
        brep.UserDictionary.Set("common_model_id", body.get("id", ""))
        brep.UserDictionary.Set("common_model_family", body.get("family", ""))
        brep.UserDictionary.Set("common_model_label", body.get("label", ""))
    return brep


gh_path = ghenv.Component.OnPingDocument().FilePath.replace("/", "\\")
gh_dir = gh_path.rsplit("\\", 1)[0]
repo_root = gh_dir.rsplit("\\examples", 1)[0]
DEFAULT_MODEL_PATH = repo_root + r"\server\robot_control\shared_geometry\hologram_model.json"
DEFAULT_RESET_MODEL_PATH = repo_root + r"\server\robot_control\shared_geometry\hologram_model - Copy.json"

added_reset_input = ensure_reset_input()
model_file = optional_input("model_path", DEFAULT_MODEL_PATH)
reset_file = DEFAULT_RESET_MODEL_PATH
if optional_bool("reset"):
    if not os.path.exists(reset_file):
        raise FileNotFoundError("reset model copy not found: {0}".format(reset_file))
    with open(reset_file, "r", encoding="utf-8") as handle:
        json.load(handle)
    shutil.copyfile(reset_file, model_file)
    print("Reset {0} from {1}".format(model_file, reset_file))

if not os.path.exists(model_file):
    raise FileNotFoundError("common_model.json not found: {0}".format(model_file))

with open(model_file, "r", encoding="utf-8") as handle:
    model = json.load(handle)

default_section = (((model.get("defaults") or {}).get("solid") or {}).get("section") or {})
breps = []
labels = []
for body in model.get("bodies", []):
    brep = beam_to_brep(body, default_section)
    if brep:
        breps.append(brep)
        labels.append("{0} ({1}): {2}".format(body.get("id"), body.get("family"), body.get("label")))

geometry = breps
a = breps
if added_reset_input:
    print("Added reset input. Wire a Button to it, then press reset to reload the copy JSON.")
print("Loaded {0} beam Breps from {1}".format(len(breps), model_file))
print("Model: {0}".format(model.get("name", "unnamed")))
# ---------- end hologram_model ----------

xy_plane = XYPlane(Origin=Point(0, 0, 0))
unit_z = UnitZ(Factor="157.5")
move = Move(Geometry=xy_plane, Motion=unit_z)  # -> Geometry, Transform

# ---- group: Open
mesh = Mesh(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)

# ----
mesh_2 = Mesh(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)
stream_filter = StreamFilter(Gate=open_gripper, Stream0=mesh, Stream1=mesh_2)

brep = Brep(hologram_model.geometry)
xy = XYPlane(Origin=Point(0, 0, 0))
Z = UnitZ(Factor=Slider(0.09, range=0..0.1))
planesrf = PlaneSurface(Plane=xy, XSize=Domain(-10, 10), YSize=Domain(-10, 10))
neg = Negative(Value=Z)
move_2 = Move(Geometry=planesrf, Motion=neg)  # -> Geometry, Transform

series = Series(Start=0, Step=1, Count="9")
rotate = Rotate(Geometry=brep, Angle=1.570796327, Plane=PlaneXY(0, 0, 0))  # -> Geometry, Transform
concatenate = Concatenate(FragmentA="dynamic_snappy-V44B80_box", FragmentB=series)

concatenate_2 = Concatenate(FragmentA="dynamic_", FragmentB=series)
Z_2 = UnitZ(Factor="0, 0, 0.09")
neg_2 = Negative(Value=Z_2)
move_3 = Move(Geometry=rotate.Geometry, Motion=neg_2)  # -> Geometry, Transform
brep_2 = Brep(rotate.Geometry)

# ---- group: physical
brep_3 = Brep(py3.geometry)

# ---- group: make sure this is true for listening
toggle = BooleanToggle(True)

# ----
wsconnection = WsConnection(Address="ws://localhost:9090", Reset=Button())  # -> WebsocketObject, ConnectionInfo

# ---- group: Reset UR10
publish_topic = PublishTopic(
    WSC=wsconnection.WebsocketObject,
    TopicName="/Robot/reset",
    MessageType="std_msgs/String",
    Message="UR10",
    Publish=Button())

# ----
hololens = Hololens(
    WebsocketObject=wsconnection.WebsocketObject,
    Disable=False,
    DeviceName="HOLO1",
    SkillConfiguration="{\"monitor\": 1, \"screw\": 1, \"pick\": 1, \"place\": 1}")  # -> Output, ARDevice

# ---- group: model listener
modeltracker = ModelTracker(Online=toggle, ARDevice=hololens.ARDevice, Meshes=rotate.Geometry, Names=concatenate_2)  # -> Status, Names, DebugTransformsX, DebugTransformsT, TransformedMesh
mesh_3 = Mesh(modeltracker.TransformedMesh)
py3_2 = Python3Script(
    orient=modeltracker.DebugTransformsX,
    transl=modeltracker.DebugTransformsT,
    names=concatenate_2,
    tracked_meshes=modeltracker.TransformedMesh)  # -> out, a; inputs orient: list, transl: list, names: list of String, tracked_meshes: list of Mesh
# ---------- py3_2: Python ----------
#! python 3
"""Sync ModelTracker-observed geometry to WORLD_MODEL.json.

The ModelTracker transforms are used only as change events/fingerprints. The
actual WORLD_MODEL pose is computed from ModelTracker's transformed mesh output
so we do not need to guess how Vizor composes orientation + translation.

Connect:
  orient -> ModelTracker DebugTransforms X
  transl -> ModelTracker DebugTransforms T
  names -> ModelTracker Names, or the same dynamic_* names in the same order
  tracked_meshes -> ModelTracker Mesh Out
"""

import importlib.util
import json
import os
import sys
import tempfile

WORLD_MODEL_PATH = r"C:\Users\Samuel\Documents\github\DF2025_CLEAN\langgraph_system\data\WORLD_MODEL.json"
CACHE_PATH = r"C:\Users\Samuel\Documents\github\DF2025_CLEAN\langgraph_system\data\.model_tracker_cache.json"
HELPER_PATH = r"C:\Users\Samuel\Documents\github\DF2025_CLEAN\langgraph_system\model_tracker_sync.py"
TRACKER_NAMES_PATH = r"C:\Users\Samuel\Documents\github\DF2025_CLEAN\langgraph_system\tracker_names.py"


def load_module(module_name, path):
    spec = importlib.util.spec_from_file_location(module_name, path)
    module = importlib.util.module_from_spec(spec)
    sys.modules[spec.name] = module
    spec.loader.exec_module(module)
    return module


sync_helper = load_module("df2025_model_tracker_sync", HELPER_PATH)
tracker_names = load_module("df2025_tracker_names", TRACKER_NAMES_PATH)


def as_list(value):
    if value is None:
        return []
    if isinstance(value, (list, tuple)):
        return list(value)
    try:
        return list(value)
    except TypeError:
        return [value]


def is_identity(xform, tol=1e-6):
    for r in range(4):
        for c in range(4):
            expected = 1.0 if r == c else 0.0
            if abs(xform[r, c] - expected) > tol:
                return False
    return True


def xform_fingerprint(xform):
    return [round(xform[r, c], 6) for r in range(4) for c in range(4)]


def parse_element_id(name):
    return tracker_names.canonical_element_id(name)


def mesh_points(mesh):
    if mesh is None:
        return []

    # Rhino.Geometry.Mesh
    if hasattr(mesh, "Vertices"):
        return [[v.X, v.Y, v.Z] for v in mesh.Vertices]

    # Defensive fallback for Brep-like inputs if a connection gives breps.
    if hasattr(mesh, "GetBoundingBox"):
        bbox = mesh.GetBoundingBox(True)
        corners = bbox.GetCorners()
        return [[p.X, p.Y, p.Z] for p in corners]

    return []


def load_cache():
    if os.path.exists(CACHE_PATH):
        try:
            with open(CACHE_PATH, "r") as f:
                data = json.load(f)
            data.setdefault("originals", {})
            data.setdefault("last_xforms", {})
            return data
        except Exception:
            pass
    return {"originals": {}, "last_xforms": {}}


def save_cache(cache):
    with open(CACHE_PATH, "w") as f:
        json.dump(cache, f, indent=2)


def write_world_model(wm):
    dir_name = os.path.dirname(WORLD_MODEL_PATH)
    fd, tmp_path = tempfile.mkstemp(dir=dir_name, suffix=".json")
    try:
        with os.fdopen(fd, "w") as f:
            json.dump(wm, f, indent=2)
        os.replace(tmp_path, WORLD_MODEL_PATH)
    except Exception:
        if os.path.exists(tmp_path):
            os.unlink(tmp_path)
        raise


# Main
status_lines = []
orient_list = as_list(orient)
transl_list = as_list(transl)
name_list = [str(n) for n in as_list(names)]
mesh_list = as_list(tracked_meshes)

if orient_list and transl_list and name_list:
    cache = load_cache()
    elem_originals = cache["originals"]
    last_xforms = cache["last_xforms"]
    cache_dirty = False

    moved_elements = {}
    limit = min(len(name_list), len(orient_list), len(transl_list))

    for i in range(limit):
        eid = parse_element_id(name_list[i])
        if eid is None:
            status_lines.append(f"ignored non-canonical tracker name: {name_list[i]}")
            continue
        o = orient_list[i]
        t = transl_list[i]
        fp = xform_fingerprint(o) + xform_fingerprint(t)
        ident_now = is_identity(o) and is_identity(t)
        was_moving = eid in last_xforms

        if ident_now and was_moving:
            elem_originals.pop(eid, None)
            last_xforms.pop(eid, None)
            cache_dirty = True
            status_lines.append(f"{eid}: confirmed, cache cleared.")
            continue

        if ident_now:
            continue

        if not sync_helper.should_process_fingerprint(eid, fp, last_xforms):
            continue

        if i >= len(mesh_list):
            status_lines.append(f"{eid}: skipped, no tracked mesh at index {i}.")
            continue

        moved_elements[eid] = (i, fp)

    if not moved_elements:
        if cache_dirty:
            save_cache(cache)
        if not status_lines:
            status_lines.append("No changes.")
    else:
        with open(WORLD_MODEL_PATH, "r") as f:
            wm = json.load(f)

        wm_by_id = {e["id"]: e for e in wm["elements"]}
        updated = []

        for eid, (mesh_index, fp) in moved_elements.items():
            if eid not in wm_by_id:
                status_lines.append(f"{eid}: skipped, not found in WORLD_MODEL.json.")
                continue

            e = wm_by_id[eid]
            points = mesh_points(mesh_list[mesh_index])
            if not points:
                status_lines.append(f"{eid}: skipped, tracked mesh has no points.")
                continue

            # Keep cache schema compatible with baseline_feed. originals is no
            # longer used for applying transforms, but preserving the first
            # pre-confirmation pose helps with debugging.
            elem_originals.setdefault(eid, {
                "center": list(e["center"]),
                "start": list(e["endpoints"]["start"]["coordinates"]),
                "end": list(e["endpoints"]["end"]["coordinates"]),
            })

            pose = sync_helper.compute_observed_pose(
                points,
                length=e["length"],
                previous_direction=e.get("direction"),
            )

            e["center"] = pose["center"]
            e["direction"] = pose["direction"]
            e["endpoints"] = sync_helper.recompute_endpoints(e)
            last_xforms[eid] = fp
            updated.append(eid)
            c = e["center"]
            status_lines.append(f"{eid}: observed mesh center ({c[0]:.4f}, {c[1]:.4f}, {c[2]:.4f})")

        if updated:
            try:
                write_world_model(wm)
                save_cache(cache)
                status_lines.append(f"Updated {len(updated)} element(s) from observed mesh.")
            except Exception as e:
                status_lines.append(f"Write failed: {e}")
        else:
            if cache_dirty:
                save_cache(cache)
            status_lines.append("No writable observed mesh updates.")
else:
    status_lines.append("Waiting for orient/transl/names inputs...")

a = "\n".join(status_lines)
print(a)
# ---------- end py3_2 ----------

# ----
# ROBOT KINEMATICS [unit: mm]
plane = Plane(construct_point)
flip_plane = FlipPlane(Plane=plane, ReverseX=False, ReverseY=False, SwapAxes=True)
merge = Merge(Data1=Toggle(False), Data2=Toggle(False), Data3=Toggle(True))
point = Point(Point(-3.536362293, -1.54850738, 0))
define_end_effector = DefineEndEffector(Geometry=stream_filter, TCPFrame=move.Geometry, MountingFrame=PlaneXY(0, 0, 0))
xy_plane_2 = XYPlane(Origin=point)

# ----
# Define Robot
xy_plane_3 = XYPlane(Origin=Point(0, 0, 0))
predefined_universal_robot_ur10 = PredefinedUniversalRobotUR10(BaseFrame=xy_plane_3, EndEffectorOptional=define_end_effector)
links = Panel("""new_ur10_gripper
base_link
base_link_inertia
shoulder_link
upper_arm_link
forearm_link
wrist_1_link
wrist_2_link
wrist_3_link
flange""")
robot = Robot(
    WebsocketObject=wsconnection.WebsocketObject,
    Disable=Button(),
    RobotName="UR10",
    VirtualRobotModelNS=predefined_universal_robot_ur10,
    AxisToggles=merge,
    JointNames=links)  # -> Output, RobotObject

robot_inverse_kinematics = RobotInverseKinematics(Robot=predefined_universal_robot_ur10, TargetTCPFrame=flip_plane, AxisToggles=merge, useColorPreview=True)  # -> PoseGeometry, AxisValues, AxisFrames

# ---- group: just to give it a bit of differentiation
display_rule = DisplayRule(TargetAnchor=robot.RobotObject, anchorType="session")
repeat_data = RepeatData(
    Data=[ColourSwatch(SwatchColor=RGB(148, 185, 255)), ColourSwatch(SwatchColor=RGB(196, 255, 176)), ColourSwatch(SwatchColor=RGB(255, 176, 176))],
    Length="9")

# ---- group: AR display
scene_mesh_object = SceneMeshObject(
    TargetAnchor=robot.RobotObject,
    Meshes=rotate.Geometry,
    Names=concatenate,
    Colours=repeat_data,
    DisplayRules=display_rule)  # -> Output, MeshGeometryObjects

# ---- group: moveit model
scene_mesh_object_2 = SceneMeshObject(TargetAnchor=robot.RobotObject, Meshes=brep_3, Names=concatenate_2, Colours=repeat_data, DisplayRules=display_rule)  # -> Output, MeshGeometryObjects

# ----
construct_scene_content = ConstructSceneContent(Name="cool beams", Meshes=scene_mesh_object.MeshGeometryObjects, LevelOfDetail=0)

# ----
# moveit scene
button = Button()
planning_scene_model = PlanningSceneModel(
    Robot=robot.RobotObject,
    SceneGeometries=scene_mesh_object_2.MeshGeometryObjects,
    TriggerSend=button,
    TriggerRemove=Button())

# ----
# AR scene
button_2 = Button()
xr_scene_model = XRSceneModel(
    GHControl=True,
    ARDevices=hololens.ARDevice,
    ContentObjects=construct_scene_content,
    TriggerSend=button_2,
    TriggerRemove=Button(),
    TimeDelay=100)

panel = Panel(planning_scene_model)
